# Grasshopper definition HopfSeifertSurf.gh (Grasshopper 1.0.7)
# plug-ins: Kangaroo Components, Weaverbird, Kangaroo2 Components

mesh = Mesh(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)
wbloop = WeaverbirdsLoopSubdivision(MeshCurves=mesh, Level=3, SmoothNakedEdges=1)
clean = CombineClean(Meshes=wbloop)
medges = MeshEdges(Mesh=clean)  # -> NakedEdges, InteriorEdges, NonManifoldEdges
join = JoinCurves(Curves=medges.NakedEdges, Preserve=False)
medges_2 = MeshEdges(Mesh=clean)  # -> NakedEdges, InteriorEdges, NonManifoldEdges
explode = Explode(Curve=join, Recursive=True)  # -> Segments, Vertices
length_line = LengthLine(Line=medges_2.NakedEdges, Length=0, Strength=1)
crv = Curve([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])
end = EndPoints(Curve=explode.Segments)  # -> Start, End
button = Button()
oncurve = OnCurve(Points=end.End, Curve=graft(crv), Strength=1000)
ls = LiveSoap(Mesh=clean, UseVolume=False, VolumeChange=0, Strength=0.001, Reset=button)
entwine = Entwine(Branch00=ls, Branch01=[length_line, oncurve], FlattenInputs=True)
solver = Solver(GoalObjects=entwine, Reset=button, Threshold=1e-15, Tolerance=0.0001, On=Toggle(True))  # -> I, V, O
bang = ExplodeTree(Data=solver.O)  # -> Branch0, Branch1
cir = Circle(Plane=PlaneXY(0, 0, 0), Radius=1)
mesh_2 = Mesh(bang.Branch0)
mb = MöbiusTransformation(Geometry=mesh_2, Circle=cir, T=Slider(0, range=0..6.283), Q=1, FixSphere=False)
wbloop_2 = WeaverbirdsLoopSubdivision(MeshCurves=mb, Level=1, SmoothNakedEdges=1)
