# Grasshopper definition solvertime.gh (Grasshopper 1.0.7)
# plug-ins: Kangaroo2 Components

W = WidthCount(50)
mplane = MeshPlane(Boundary={Plane=PlaneXY(35, 35, 0), Size=Domain2(u=-35..35, v=-35..35)}, WidthCount=W, HeightCount=W)  # -> Mesh, Area
clean = CombineClean(Meshes=mplane.Mesh)
medges = MeshEdges(Mesh=clean)  # -> NakedEdges, InteriorEdges, NonManifoldEdges
demesh = DeconstructMesh(Mesh=clean)  # -> Vertices, Faces, Colours, Normals
mc = MeshCorners(Mesh=clean, Angle=2.35619449)
len = Length(Curve=medges.InteriorEdges)
cp = ClosestPoint(Point=mc, Cloud=demesh.Vertices)  # -> ClosestPoint, CPIndex, Distance
item = ListItem(List=len, Index=0, Wrap=True)
customiteration = CSharpScript(
    M=clean,
    length=item,
    x=cp.CPIndex,
    iters="2000",
    Reference="C:\Users\Daniel\Documents\GitHub\Kangaroo2\bin\Release\KangarooSolver.dll")  # -> out, A, B, C; inputs M: Mesh, length: Double, x: list of Int32, iters: Int32
# ---------- customiteration: C# usings ----------
using System.IO;
using System.Linq;
using System.Data;
using System.Drawing;
using System.Reflection;
using System.Windows.Forms;
using System.Xml;
using System.Xml.Linq;
using System.Runtime.InteropServices;

using Rhino.DocObjects;
using Rhino.Collections;
using GH_IO;
using GH_IO.Serialization;
using KangarooSolver;
using KangarooSolver.Goals;
using System.Diagnostics;
# ---------- customiteration: C# ----------
    Mesh M2 = M.DuplicateMesh();
    //initialize the solver
    var PS = new KangarooSolver.PhysicalSystem();
    var Goals = new List<IGoal>();

    //get the Mesh points and boundary status
    Point3d[] Pts = M.Vertices.ToPoint3dArray();
    bool[] Naked = M.GetNakedEdgePointStatus();

    Vector3d load = new Vector3d(0, 0, -0.001);
    for(int i = 0; i < M.Vertices.Count;i++)
    {
      PS.AddParticle(Pts[i], 1); //add a particle for every mesh vertex
      Goals.Add(new KangarooSolver.Goals.Unary(i, load));
    }

    for(int i = 0; i < x.Count;i++)
    {Goals.Add(new KangarooSolver.Goals.Anchor(x[i], Pts[x[i]], 10000000));}// fix the boundaries strongly in place

    for(int i = 0; i < M.TopologyEdges.Count;i++)
    {
      var Ends = M.TopologyEdges.GetTopologyVertices(i);
      int Start = M.TopologyVertices.MeshVertexIndices(Ends.I)[0];
      int End = M.TopologyVertices.MeshVertexIndices(Ends.J)[0];
      Goals.Add(new KangarooSolver.Goals.Spring(Start, End, length, 1)); //for each edge, a spring with rest length 0, and strength 1
    }

    int counter = 0;
    double threshold = 1e-6;

    Stopwatch stopWatch = new Stopwatch();
    stopWatch.Start();

    do
    {
      PS.Step(Goals, true, threshold);
      counter++;
    }while(PS.GetvSum() > threshold && counter < iters);

    stopWatch.Stop();
    TimeSpan ts = stopWatch.Elapsed;
    C = ts.Milliseconds;
    M.Vertices.Clear();
    M.Vertices.AddVertices(PS.GetPositions());

    //Output the mesh, and how many iterations it took to converge
    A = M;
    B = counter;
# ---------- end customiteration ----------
solver_time_in_ms = Panel(customiteration.C)
